# Dynamo graph IdentifyingDuplicatedWords.dyn (Dynamo 2.1.0.7500)

string = StringInput("\b(\w+?)\s\1\b")
code_block = CodeBlock { "\\b(\\w+?)\\s\\1\\b"; }
byPattern = RegularExpressions.Regex.ByPattern(pattern=[code_block, code_block])
names = CodeBlock { "This this is a nice day. What about this? This tastes good. I saw a a dog."; }
matches = RegularExpressions.Regex.Matches(regex=byPattern, input=names)
